# Requirement set robotBuilder (R2024b)

## 1 [#2] Support incremental construction

### 1.1 [#6] Support parent-child relationships

#### 1.1.1 [#22] URDFTag should be able to add a child tag with unique name

#### 1.1.2 [#24] URDFTag should be able to remove a child tag by name

#### 1.1.3 [#25] URDFTag should be able to find a child by type or name or both

#### 1.1.4 [#20] URDFTag subclass should provide a list of valid child types

#### 1.1.5 [#21] addChild should throw an error if it cannot add a child

#### 1.1.6 [#12] Link is a valid child of a Robot

#### 1.1.7 [#13] Joint is a valid child of a Robot

##### 1.1.7.1 [#26] Parent link should be an existing Link

##### 1.1.7.2 [#27] Child link should be an existing Link

#### 1.1.8 [#14] Material is a valid child of a Robot

#### 1.1.9 [#15] Visual is a valid child of a Link

#### 1.1.10 [#16] Geometry is a valid child of a Visual

#### 1.1.11 [#17] Origin is a valid child of a Visual

#### 1.1.12 [#18] Origin is a valid child of a Joint

### 1.2 [#7] Support reusable components

#### 1.2.1 [#28] Link is a valid child of a Component

#### 1.2.2 [#29] Joint is a valid child of a Component

#### 1.2.3 [#39] Component is a valid child of a Component

#### 1.2.4 [#30] All atttributes of Links and Joints within the Component can be parametrized

##### 1.2.4.1 [#31] Parameter should have name

##### 1.2.4.2 [#32] Parameter should have a default value

##### 1.2.4.3 [#33] Parameter should have a description

##### 1.2.4.4 [#34] Parameter can be attached to a node using a path

#### 1.2.5 [#35] Component Instance should have a unique name

##### 1.2.5.1 [#36] Instance Links and Joints should prefix instance name to their own names

#### 1.2.6 [#37] Component Instance should replace all node attributes attached to parameters with specified value or default

#### 1.2.7 [#38] Support converting selected Links and Joints into a Component

## 2 [#3] Validate structure

### 2.1 [#8] Each element should be a valid URDF tag or attribute

### 2.2 [#9] Each element tag must have a unique name

### 2.3 [#11] Each element tag must have a type attribute

### 2.4 [#10] Element tags can have at most one parent

## 3 [#4] Support import from urdf files

## 4 [#5] Support export to urdf file

## 5 [#19] Support all valid URDF tags